# Grasshopper definition Graph_generator_Amesterdam_autosave.gh (Grasshopper 1.0.7)
# plug-ins: DeCodingSpaces, Heteroptera, KohonenMapper, Human

point = Point([<point referenced from the Rhino model> x5000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])
edges = Curve([<curve referenced from the Rhino model> x5000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])
panel = Panel(edges)
length = Length(Curve=edges)
dispatch = Dispatch(List=point, DispatchPattern=[True, False])  # -> ListA, ListB
min_max = MinMax(Number=length)  # -> Minimum, Maximum

# ---- group: Input number
number_slider = Slider(6, range=0..100)

# ---- group: 5 dimensions
number_slider_2 = Slider(8, range=0..10)

# ----
point_2 = Point(dispatch.ListA)
point_3 = Point(dispatch.ListB)
random_reduce = RandomReduce(List=edges, Reduction=Slider(10, range=0..10), Seed=1)
panel_2 = Panel(min_max.Minimum)
panel_3 = Panel(min_max.Maximum)
line = Line(StartPoint=point_2, EndPoint=point_3)
distance = Distance(PointA=point_2, PointB=point_3)
dispatch_2 = Dispatch(List=edges, DispatchPattern=[True, False])  # -> ListA, ListB
# Input parameters
number_slider_3 = Slider(4, range=0..10)
multiplication = Multiplication(A=number_slider, B=number_slider_2)
min_max_2 = MinMax(Number=distance)  # -> Minimum, Maximum
random = Random(Range=Domain(0, 1), Number=multiplication, Seed=number_slider_3)
angle = Angle(VectorA=dispatch_2.ListA, VectorB=dispatch_2.ListB)  # -> Angle, Reflex
curve = Curve(<curve referenced from the Rhino model>)

# ---- group: Builds a data-tree of the inputs' feature vector
c_script = CSharpScript(x=random, y=number_slider_2)  # -> A; inputs x: list of Double, y: Int32
# ---------- c_script: C# ----------
    var tree = new DataTree<double>();
    GH_Path path;
    int legge = x.Count / y;
    int counter = 0;
    
    for (int i = 0; i < legge; i++)
    {
      path = new GH_Path(i);
      for (int j = 0; j < y; j++)
      {
        tree.Add(x[counter], path);
        counter++;
      }
    }

    A = tree;
# ---------- end c_script ----------

# ----
panel_4 = Panel(angle.Angle)
num = Number(c_script)
street_network_generator = StreetNetworkGenerator(
    Boundary=curve,
    MinLength=panel_2,
    MaxLength=panel_3,
    MinDist=min_max_2.Minimum,
    RandomAngle=10,
    MaxArms=4,
    TreeDepth=7,
    ProbabilityToAddArms=1,
    SeedForRandom=-1)
panel_5 = Panel(num)
number_slider_4 = Slider(0.999, range=0..1)

# ---- group: The original seed
panel_6 = Panel("6")

# ----
timer = Timer(Interval=20, TimerInterval=20, Target=kohonen_map)  # disabled
kohonen_map = KohonenMap(
    Reset=Toggle(False),
    XMap=Slider(16, range=0..100),
    YMap=Slider(8, range=0..100),
    Space=Slider(10, range=0..10),
    Inputs=1,
    WinLearn="0.98",
    Learn="0.95",
    WinLearnDecay=number_slider_4,
    LearnDecay=number_slider_4,
    NeighDecay=Slider(0.996, range=0..1),
    NeighRad=Slider(0.5, range=0..1),
    Seed=panel_6)  # -> Coverged, Counter, Locations, Synaptics, Neigh, InputLocations
item = ListItem(List=kohonen_map.Synaptics, Index=0, Wrap=True)  # -> Item, Item1, Item2, Item3, Item4, Item5, Item6, Item7
cluster = Cluster(pt=kohonen_map.Locations, num=kohonen_map.Synaptics)  # -> L, pl
cluster_2 = Cluster_2(pt=graft(kohonen_map.InputLocations), num=simplify(num))  # -> L, pl
cir = Circle(Plane=kohonen_map.InputLocations, Radius=1)
xyz = ColourXYZ(Alpha=1, X=item.Item, Y=item.Item4, Z=item.Item2)
fillet = Fillet(Curve=cluster.pl, Radius=Slider(0.2, range=0..1))
scale = Scale(Geometry=fillet, Center=kohonen_map.Locations, Factor=expr("x*1.5", item.Item3))  # -> Geometry, Transform
preview = CustomPreview(Geometry=cir, Shader=ColourSwatch(SwatchColor=RGB(0, 0, 0)))
preview_2 = CustomPreview(
    Geometry=cluster_2.L,
    Material={diffuse=RGB(221, 160, 221), emission=RGB(66, 48, 66), shine=0.5, specular=RGB(255, 255, 255), transparency=0})
previewlw = CustomPreviewLineweights(Geometry=cluster_2.pl, Shader=ColourSwatch(SwatchColor=RGB(0, 0, 0)), Thickness=Slider(4, range=0..10), Absolute=False)
srf = Surface(scale.Geometry)
# (glyph geometry)
previewlw_2 = CustomPreviewLineweights(Geometry=srf, Shader=xyz, Absolute=False)

# ==== cluster Cluster
num = ClusterInput()
pt = ClusterInput()
num_2 = Number(num)
pt_2 = Point(pt)
panel = Panel("""0
0""")
path = ConstructPath(Indices=panel)
branch = TreeBranch(Tree=num_2, Path=path, MaintainPaths=True)
lng = ListLength(List=flatten(branch))
cir = Circle(Plane=pt_2, Radius=Slider(0.9, range=0..1))
divide = DivideCurve(Curve=cir, Count=lng, Kinks=False)  # -> Points, Tangents, Parameters
vec2pt = Vector2Pt(PointA=pt_2, PointB=divide.Points, Unitize=False)  # -> unitize(Vector), Length
line = LineSDL(Start=simplify(pt_2), Direction=simplify(vec2pt.Vector), Length=num_2)
end = EndPoints(Curve=line)  # -> Start, End
L = ClusterOutput(line)
pline = PolyLine(Vertices=end.End, Closed=True)
pl = ClusterOutput(pline)

# ==== cluster Cluster_2
num = ClusterInput()
pt = ClusterInput()
num_2 = Number(num)
pt_2 = Point(pt)
path = ConstructPath(Indices="0")
branch = TreeBranch(Tree=num_2, Path=path, MaintainPaths=True)
lng = ListLength(List=flatten(branch))
cir = Circle(Plane=pt_2, Radius=Slider(0.9, range=0..1))
divide = DivideCurve(Curve=cir, Count=lng, Kinks=False)  # -> Points, Tangents, Parameters
vec2pt = Vector2Pt(PointA=pt_2, PointB=divide.Points, Unitize=False)  # -> unitize(Vector), Length
line = LineSDL(Start=simplify(pt_2), Direction=simplify(vec2pt.Vector), Length=num_2)
end = EndPoints(Curve=line)  # -> Start, End
L = ClusterOutput(line)
pline = PolyLine(Vertices=end.End, Closed=True)
pl = ClusterOutput(pline)
